vi "Function.gviweb"   [LabVIEW NXG 2.1.0]
uses:
  NI::Skyline::Configuration::Open Configuration.gvi
  NI::Skyline::MessageHTTP::Open.gvi
  NI::Skyline::MessageHTTP::Publish.gvi
  NI::Skyline::MessageHTTP::Flush.gvi
  NI::Skyline::Configuration::Close Configuration.gvi
  NI::Skyline::MessageHTTP::Subscribe.gvi
  NI::Skyline::MessageHTTP::Read.gvi
  NI::Skyline::MessageHTTP::Unsubscribe.gvi
diagram:
  sequence {
    frame 0 {
      call "Open Configuration.gvi"(server url="http://localhost:80/", username="admin", password="password") -> (configuration=w1, error out=w2)
      call "Open.gvi"(error in=w2, configuration=w1) -> (message session out=w3, error out=w4)
    }
    frame 1 {
      s1 = w3  # shift register
      s2 = w4  # shift register
      while {
        call "Publish.gvi"(message session=s1, topic="TopicName", message="New Message\n..................\n..................", error in=s2) -> (message session out=w5, error out=w6)
        next s1 = w5
        next s2 = w6
        stop if FALSE
      }
    }
    frame 2 {
      call "Flush.gvi"(message session=s1, error in=s2) -> (error out=w7)
      call "Close Configuration.gvi"(configuration=w1, error in=w7)
    }
  }
  sequence {
    frame 0 {
      call "Open Configuration.gvi"(server url="http://localhost:80/", username="admin", password="password") -> (configuration=w8, error out=w9)
      call "Open.gvi"(error in=w9, configuration=w8) -> (message session out=w10, error out=w11)
    }
    frame 1 {
      call "Subscribe.gvi"(message session=w10, topic="TopicName", error in=w11) -> (message session out=w12, error out=w13)
    }
    frame 2 {
      s3 = w12  # shift register
      s4 = w13  # shift register
      while {
        call "Read.gvi"(message session=s3, error in=s4) -> (message session out=w14, topic=w15, message=w16, error out=w17)
        sequence (after w15) (after w16) {
          frame 0 { }
        }
        next s3 = w14
        next s4 = w17
        stop if FALSE
      }
    }
    frame 3 {
      call "Unsubscribe.gvi"(message session=s3, topic="TopicName", error in=s4) -> (message session out=w18, error out=w19)
    }
    frame 4 {
      call "Flush.gvi"(message session=w18, error in=w19) -> (error out=w20)
      call "Close Configuration.gvi"(configuration=w8, error in=w20)
    }
  }
