vi "Main.gviweb"   [LabVIEW NXG 2.1.0]
panel controls:
  "High": f64
  "Low": f64
  "Update": bool
panel indicators:
  "Current Tempetrature": f64
  "Heater State": bool
  "High Limit": f64
  "Low Limit": f64
  "Temperature Trend": T1
  "Heater State Trend": i16
types:
  T1 = cluster{"Element 1": f64, "Element 2": f64, "Element 3": f64}
uses:
  NI::Skyline::Configuration::Open Configuration.gvi
  NI::Skyline::MessageHTTP::Open.gvi
  NI::Skyline::MessageHTTP::Subscribe.gvi
  NI::Skyline::MessageHTTP::Read.gvi
  NI::Skyline::MessageHTTP::Publish.gvi
  NI::Skyline::MessageHTTP::Unsubscribe.gvi
  NI::Skyline::MessageHTTP::Close.gvi
  NI::Skyline::Configuration::Close Configuration.gvi
diagram:
  call "Open Configuration.gvi"(server url="http://localhost:80", username="admin", password="q") -> (configuration=w1, error out=w2)
  call "Open.gvi"(error in=w2, configuration=w1) -> (message session out=w3, error out=w4)
  call "Subscribe.gvi"(message session=w3, topic="TCdata", error in=w4) -> (message session out=w5, error out=w6)
  s1 = w5  # shift register
  s2 = w6  # shift register
  while {
    call "Read.gvi"(message session=s1, timeout milliseconds=-1, error in=s2) -> (dequeue status=w7, message session out=w8, message=w9, error out=w10)
    case (w7) {
      frame False, Default {
        w11 = w10
      }
      frame True {
        w12 = cluster{"h": f64, "l": f64, "c": f64, "s": bool} {all zero or empty}  # r
        Unflatten From JSON(JSON string=w9, error in (no error)=w10, type and defaults=w12) -> (error out=w11, value=w13)
        Property Node(instance in=w13) -> ("h"=w14, "l"=w15, "c"=w16, "s"=w17)
        Build Cluster(w16, w15, w14) -> w18
        $"Temperature Trend" <- w18
        $"High Limit" <- w14
        $"Low Limit" <- w15
        $"Current Tempetrature" <- w16
        $"Heater State" <- w17
        Boolean To Integer(Boolean=w17) -> (0, 1=w19)
        $"Heater State Trend" <- w19
      }
    }
    Property Node(instance in=cluster{"high": f64, "low": f64} {all zero or empty}, "high"=$High, "low"=$Low) -> (instance out=w20)
    Flatten To JSON(anything=w20) -> (JSON string=w21)
    case ($Update) {
      frame False, Default {
        w22 = w11
        w23 = w8
      }
      frame True {
        call "Publish.gvi"(message session=w8, topic="Limit", message=w21, error in=w11) -> (message session out=w23, error out=w22)
      }
    }
    Wait(time to wait=100)
    next s1 = w23
    next s2 = w22
    stop if FALSE
  }
  call "Unsubscribe.gvi"(message session=s1, topic="TCdata", error in=s2) -> (message session out=w24, error out=w25)
  call "Close.gvi"(message session=w24, error in=w25) -> (error out=w26)
  call "Close Configuration.gvi"(configuration=w1, error in=w26)
